# Grasshopper definition HKIBIM_Automation_20250328_gh.gh (Grasshopper 1.0.7)
# plug-ins: RhinoCodePluginGH, HKIBIM_Automation_2025_Demo2

number_slider = Slider(21, range=0..40)
number_slider_2 = Slider(27, range=0..40)
number_slider_3 = Slider(10, range=0..40)

# ---- group: curve direction
curve = Curve([<curve referenced from the Rhino model> x52])
evaluate_length = EvaluateLength(Curve=curve, Length=Slider(0.14, range=0..1), Normalized=True)  # -> Point, Tangent, Parameter
vector_display = VectorDisplay(Anchor=evaluate_length.Point, Vector=evaluate_length.Tangent)

# ----
curve_2 = Curve([<curve referenced from the Rhino model> x18])
sort_curves = Script(curves=curve_2)  # -> out, a; inputs curves: list
# ---------- sort_curves: Python ----------
import rhinoscriptsyntax


sorted_curves = sorted(curves, key=lambda curve: curve.PointAtStart.Y,reverse=True)

a=sorted_curves
# ---------- end sort_curves ----------
list_length = ListLength(List=sort_curves.a)
curve_3 = Curve(sort_curves.a)
divide_curve = DivideCurve(Curve=curve_3, Count=number_slider, Kinks=False)  # -> Points, Tangents, Parameters
subtraction = Subtraction(A=list_length, B=1)
flip_matrix = FlipMatrix(Data=divide_curve.Points)
duplicate_data = DuplicateData(Data=flip_matrix, Number=1, Order=True)
split_list = SplitList(List=flip_matrix, Index=subtraction)  # -> ListA, ListB
split_list_2 = SplitList(List=duplicate_data, Index=1)  # -> ListA, ListB
point = Point(split_list.ListA)
point_2 = Point(split_list_2.ListB)
line = Line(StartPoint=point, EndPoint=point_2)

curve_4 = Curve([<curve referenced from the Rhino model> x2])
sort_curves_2 = Script(curves=curve_4)  # -> out, a; inputs curves: list; same code as sort_curves
list_length_2 = ListLength(List=sort_curves_2.a)
curve_5 = Curve(sort_curves_2.a)
divide_curve_2 = DivideCurve(Curve=curve_5, Count=number_slider_3, Kinks=False)  # -> Points, Tangents, Parameters
subtraction_2 = Subtraction(A=list_length_2, B=1)
flip_matrix_2 = FlipMatrix(Data=divide_curve_2.Points)
duplicate_data_2 = DuplicateData(Data=flip_matrix_2, Number=1, Order=True)
split_list_3 = SplitList(List=flip_matrix_2, Index=subtraction_2)  # -> ListA, ListB
split_list_4 = SplitList(List=duplicate_data_2, Index=1)  # -> ListA, ListB
point_3 = Point(split_list_3.ListA)
point_4 = Point(split_list_4.ListB)
line_2 = Line(StartPoint=point_3, EndPoint=point_4)

curve_6 = Curve([<curve referenced from the Rhino model> x2])
sort_curves_3 = Script(curves=curve_6)  # -> out, a; inputs curves: list; same code as sort_curves
list_length_3 = ListLength(List=sort_curves_3.a)
curve_7 = Curve(sort_curves_3.a)
divide_curve_3 = DivideCurve(Curve=curve_7, Count=number_slider_3, Kinks=False)  # -> Points, Tangents, Parameters
subtraction_3 = Subtraction(A=list_length_3, B=1)
flip_matrix_3 = FlipMatrix(Data=divide_curve_3.Points)
duplicate_data_3 = DuplicateData(Data=flip_matrix_3, Number=1, Order=True)
split_list_5 = SplitList(List=flip_matrix_3, Index=subtraction_3)  # -> ListA, ListB
split_list_6 = SplitList(List=duplicate_data_3, Index=1)  # -> ListA, ListB
point_5 = Point(split_list_5.ListA)
point_6 = Point(split_list_6.ListB)
line_3 = Line(StartPoint=point_5, EndPoint=point_6)

curve_8 = Curve([<curve referenced from the Rhino model> x14])
sort_curves_4 = Script(curves=curve_8)  # -> out, a; inputs curves: list; same code as sort_curves
list_length_4 = ListLength(List=sort_curves_4.a)
curve_9 = Curve(sort_curves_4.a)
divide_curve_4 = DivideCurve(Curve=curve_9, Count=number_slider_2, Kinks=False)  # -> Points, Tangents, Parameters
subtraction_4 = Subtraction(A=list_length_4, B=1)
flip_matrix_4 = FlipMatrix(Data=divide_curve_4.Points)
duplicate_data_4 = DuplicateData(Data=flip_matrix_4, Number=1, Order=True)
split_list_7 = SplitList(List=flip_matrix_4, Index=subtraction_4)  # -> ListA, ListB
split_list_8 = SplitList(List=duplicate_data_4, Index=1)  # -> ListA, ListB
point_7 = Point(split_list_7.ListA)
point_8 = Point(split_list_8.ListB)
line_4 = Line(StartPoint=point_7, EndPoint=point_8)

curve_10 = Curve([<curve referenced from the Rhino model> x5])
sort_curves_5 = Script(curves=curve_10)  # -> out, a; inputs curves: list; same code as sort_curves
list_length_5 = ListLength(List=sort_curves_5.a)
curve_11 = Curve(sort_curves_5.a)
divide_curve_5 = DivideCurve(Curve=curve_11, Count=number_slider, Kinks=False)  # -> Points, Tangents, Parameters
subtraction_5 = Subtraction(A=list_length_5, B=1)
flip_matrix_5 = FlipMatrix(Data=divide_curve_5.Points)
duplicate_data_5 = DuplicateData(Data=flip_matrix_5, Number=1, Order=True)
split_list_9 = SplitList(List=flip_matrix_5, Index=subtraction_5)  # -> ListA, ListB
split_list_10 = SplitList(List=duplicate_data_5, Index=1)  # -> ListA, ListB
point_9 = Point(split_list_9.ListA)
point_10 = Point(split_list_10.ListB)
line_5 = Line(StartPoint=point_9, EndPoint=point_10)

curve_12 = Curve([<curve referenced from the Rhino model> x6])
sort_curves_6 = Script(curves=curve_12)  # -> out, a; inputs curves: list; same code as sort_curves
list_length_6 = ListLength(List=sort_curves_6.a)
curve_13 = Curve(sort_curves_6.a)
divide_curve_6 = DivideCurve(Curve=curve_13, Count=number_slider_2, Kinks=False)  # -> Points, Tangents, Parameters
subtraction_6 = Subtraction(A=list_length_6, B=1)
flip_matrix_6 = FlipMatrix(Data=divide_curve_6.Points)
duplicate_data_6 = DuplicateData(Data=flip_matrix_6, Number=1, Order=True)
split_list_11 = SplitList(List=flip_matrix_6, Index=subtraction_6)  # -> ListA, ListB
split_list_12 = SplitList(List=duplicate_data_6, Index=1)  # -> ListA, ListB
point_11 = Point(split_list_11.ListA)
point_12 = Point(split_list_12.ListB)
line_6 = Line(StartPoint=point_11, EndPoint=point_12)

curve_14 = Curve([<curve referenced from the Rhino model> x2])
sort_curves_7 = Script(curves=curve_14)  # -> out, a; inputs curves: list; same code as sort_curves
list_length_7 = ListLength(List=sort_curves_7.a)
curve_15 = Curve(sort_curves_7.a)
divide_curve_7 = DivideCurve(Curve=curve_15, Count=number_slider_2, Kinks=False)  # -> Points, Tangents, Parameters
subtraction_7 = Subtraction(A=list_length_7, B=1)
flip_matrix_7 = FlipMatrix(Data=divide_curve_7.Points)
duplicate_data_7 = DuplicateData(Data=flip_matrix_7, Number=1, Order=True)
split_list_13 = SplitList(List=flip_matrix_7, Index=subtraction_7)  # -> ListA, ListB
split_list_14 = SplitList(List=duplicate_data_7, Index=1)  # -> ListA, ListB
point_13 = Point(split_list_13.ListA)
point_14 = Point(split_list_14.ListB)
line_7 = Line(StartPoint=point_13, EndPoint=point_14)

curve_16 = Curve([<curve referenced from the Rhino model> x7])
sort_curves_8 = Script(curves=curve_16)  # -> out, a; inputs curves: list; same code as sort_curves
list_length_8 = ListLength(List=sort_curves_8.a)
curve_17 = Curve(sort_curves_8.a)
divide_curve_8 = DivideCurve(Curve=curve_17, Count=Slider(39, range=0..40), Kinks=False)  # -> Points, Tangents, Parameters
subtraction_8 = Subtraction(A=list_length_8, B=1)
flip_matrix_8 = FlipMatrix(Data=divide_curve_8.Points)
duplicate_data_8 = DuplicateData(Data=flip_matrix_8, Number=1, Order=True)
split_list_15 = SplitList(List=flip_matrix_8, Index=subtraction_8)  # -> ListA, ListB
split_list_16 = SplitList(List=duplicate_data_8, Index=1)  # -> ListA, ListB
point_15 = Point(split_list_15.ListA)
point_16 = Point(split_list_16.ListB)
line_8 = Line(StartPoint=point_15, EndPoint=point_16)

merge = Merge(Data1=line, Data2=line_2, Data3=line_3, Data4=line_5, Data5=line_8, Data6=line_6, Data7=line_7, Data8=line_4)
param_viewer = ParamViewer(merge)
transom_generation = TransomGeneration(Profile="D200")
