# Grasshopper definition Internal_Envelope_WireFrame.gh (Grasshopper 1.0.7)

mesh = Mesh(<mesh referenced from the Rhino model>)
mesh_2 = Mesh([<mesh referenced from the Rhino model> x33])
medges = MeshEdges(Mesh=mesh)  # -> NakedEdges, InteriorEdges, NonManifoldEdges
medges_2 = MeshEdges(Mesh=mesh_2)  # -> NakedEdges, InteriorEdges, NonManifoldEdges
crv = Curve(medges_2.NakedEdges)
vec = VectorXYZ(XComponent=0, YComponent=250, ZComponent=0)  # -> Vector, Length
crv_2 = Curve(medges.NakedEdges)
move = Move(Geometry=crv, Motion=vec.Vector)  # -> Geometry, Transform
join = JoinCurves(Curves=move.Geometry, Preserve=False)
